# Grasshopper definition Assignment1withHops_external.gh (Grasshopper 1.0.7)
# plug-ins: Hops

panel = Panel("C:\Users\Manol\Desktop\bimsc24-datamgmt-session01\bimsc24-datamgmt-session01\Session01\Assignment 1 Vase.gh")
hops = Hops(
    _Path=panel,
    BottomWidth=Slider(6075, range=0..10000),
    MidWidth=Slider(3161, range=0..10000),
    TopWidth=Slider(6306, range=0..10000),
    TopEdgeWidth=Slider(4934, range=0..10000),
    MidLevel=Slider(3119, range=0..10000),
    TopLevel=Slider(4708, range=0..10000),
    TurnDegrees=Slider(302, range=0..360),
    CacheResultsInMemory=True,
    CacheSolveResults=True,
    RemoteDefinitionLocation="C:\Users\Manol\Desktop\bimsc24-datamgmt-session01\bimsc24-datamgmt-session01\Session01\Assignment 1 Vase.gh",
    RemoteSolveVersion=(0, 1, 0),
    ShowInput_Enabled=False,
    ShowInput_Path=True,
    SynchronousSolve=True)
