# Grasshopper definition DataMgmt-Assignment 1 Vase.gh (Grasshopper 1.0.7)

xy = XYPlane(Origin=Point(0, 0, 0))
Z = UnitZ(Factor=1)
number_slider = Slider(0, range=0..360)
line = LineSDL(Start=xy, Direction=Z, Length="1000")
turn_degrees = GetInteger(Slider(360, range=0..360), AtLeast=1, AtMost=1, Maximum=2147483647, Minimum=-2147483648, TreeAccess=False)
rad = Radians(Degrees=turn_degrees)
rad_2 = Radians(Degrees="0")
dom = ConstructDomain(DomainStart=rad_2, DomainEnd=rad)
bottom_width = GetInteger(Slider(3546, range=0..10000), AtLeast=1, AtMost=1, Maximum=2147483647, Minimum=-2147483648, TreeAccess=False)
mid_width = GetInteger(Slider(2744, range=0..10000), AtLeast=1, AtMost=1, Maximum=2147483647, Minimum=-2147483648, TreeAccess=False)
mid_level = GetInteger(Slider(6647, range=0..10000), AtLeast=1, AtMost=1, Maximum=2147483647, Minimum=-2147483648, TreeAccess=False)
top_width = GetInteger(Slider(3458, range=0..10000), AtLeast=1, AtMost=1, Maximum=2147483647, Minimum=-2147483648, TreeAccess=False)
top_level = GetInteger(Slider(7007, range=0..10000), AtLeast=1, AtMost=1, Maximum=2147483647, Minimum=-2147483648, TreeAccess=False)
top_edge_width = GetInteger(Slider(7463, range=0..10000), AtLeast=1, AtMost=1, Maximum=2147483647, Minimum=-2147483648, TreeAccess=False)

merge = Merge(Data1=bottom_width, Data2=mid_width, Data3=top_width, Data4=top_edge_width)
merge_2 = Merge(Data1=Slider(0, range=0..10000), Data2=mid_level, Data3=top_level, Data4=Slider(10000, range=0..10000))
pt = ConstructPoint(XCoordinate=merge, YCoordinate=0, ZCoordinate=merge_2)
intcrv = Interpolate(Vertices=pt, Degree=3, Periodic=False, KnotStyle=1)  # -> Curve, Length, Domain
crv = Curve(intcrv.Curve)

revsrf = Revolution(Curve=crv, Axis=line, Domain=dom)
subd = SubD(revsrf)
context_bake = ContextBake(Geometry=subd)
