# Grasshopper definition hops test.gh (Grasshopper 1.0.7)
# plug-ins: Hops

# https://github.com/iaac-macad/bimsc24-datamgmt-session01/raw/main/Session01/Spikey.gh
hops = Hops(
    Radius=Slider(10, range=0..10),
    Count=Slider(40, range=0..100),
    Length=Slider(7.06, range=0..10),
    CacheResultsInMemory=True,
    CacheSolveResults=True,
    RemoteDefinitionLocation="C:\Users\Manol\Desktop\Bootcamp Ses1\BIMSC24-bootcamp-s1-Manolya\DataMgmt-session1\bimsc24-datamgmt-session01\Session01\Spikey_hopsM.gh",
    RemoteSolveVersion=(0, 1, 0),
    ShowInput_Enabled=False,
    ShowInput_Path=False,
    SynchronousSolve=True)
hops_2 = Hops(
    CacheResultsInMemory=True,
    CacheSolveResults=True,
    RemoteDefinitionLocation="https://github.com/iaac-macad/bimsc24-datamgmt-session01/raw/main/Session01/Spikey.gh",
    RemoteSolveVersion=(0, 1, 0),
    ShowInput_Enabled=False,
    ShowInput_Path=True,
    SynchronousSolve=True)
